vi "Apped Log Text.gviweb"   [G Web Development Software 22.3.0]
inputs:
  "Input": Queue<"Message Cluster.gtype">[], required
  "resulting string": string, required
  "error out": error
outputs:
  "Output_2": error
types:
  "Message Cluster.gtype" = cluster{"Message": string, "Message Data": variant}
uses:
  WebApp::support::Message Queue::Enqueue Message (Single).gvi
diagram:
  Array Index(array=$Input) -> (out0["UI"]=w1)
  call "Enqueue Message (Single).gvi"(message queue in=w1, message="Update Status", message data=$"resulting string", error in=$"error out") -> (error out=w2)
  $Output_2 <- w2
