vi "Generate Undefined Message Error.gviweb"   [G Web Development Software 22.3.0]
inputs:
  "Queue Name": "Message Queue Names.gtype" = "Manager"
  "Message": string
  "Error in": error
outputs:
  "Error out": error
types:
  "Message Queue Names.gtype" = enum{"Manager", "UI", "IO"}
uses:
  NI::G Core::Error::Build Error Cluster.gvi
diagram:
  # Message undefined
  w1 = "The invalid message string \"%s\" was received in queue: %s."
  Format Into String(formatString=w1, $Message, $"Queue Name") -> w2
  call "Build Error Cluster.gvi"(code=1, description=w2, error in=$"Error in") -> (error out=w3)
  $"Error out" <- w3
