vi "Handle Error.gviweb"   [G Web Development Software 22.3.0]
inputs:
  "Input": Queue<"Message Cluster.gtype">
  "Input_2": "Message Queue Names.gtype" = "Manager"
  "Output_2": error
outputs:
  "Output": Queue<"Message Cluster.gtype">
  "Output_3": error
types:
  "Message Queue Names.gtype" = enum{"Manager", "UI", "IO"}
  "Message Cluster.gtype" = cluster{"Message": string, "Message Data": variant}
  "Error Data.gtype" = cluster{"Error Origin": "Message Queue Names.gtype", "Error In": error}
uses:
  WebApp::support::Message Queue::Enqueue Message (Single).gvi
diagram:
  case ($Output_2) {
    frame Error, Default {
      Property Node(instance in="Error Data.gtype" {all zero or empty}, "Error In"=$Output_2, "Error Origin"=$Input_2) -> (instance out=w3)
      To Variant(anything=w3) -> w4
      call "Enqueue Message (Single).gvi"(message queue in=$Input, message="Error", message data=w4) -> (message queue out=w1)
      w2 = $Output_2
    }
    frame No Error {
      w1 = $Input
      w2 = $Output_2
    }
  }
  $Output_3 <- w2
  $Output <- w1
