vi "Handle IO Data.gviweb"   [G Web Development Software 22.3.0]
inputs:
  "Steps Status in": "Step Status.gtype"[], required
  "Data from ui": f64[], required
  "Test Sequence Data in": f64[][], required
  "Step Index in": i32, required
outputs:
  "Steps Status out": "Step Status.gtype"[]
  "Test Sequence Data out": f64[][]
  "Step Index out": i32
types:
  "Step Result.gtype" = enum{"Pass", "Fail", "Canceled"}
  "Step Status.gtype" = cluster{"Progress": f64, "Result": "Step Result.gtype", "Complete": bool}
uses:
  WebApp::Test Hardware Values.gviweb
diagram:
  # extract progress/ status data
  Delete From Array(inArray=$"Data from ui", index0=0) -> (outArray=w1, deleted=w2)
  disable {
    frame Enabled {
      w3 = $"Step Index in"
    }
    frame Disabled {
      Array Size(array=$"Steps Status in") -> (size(s)=w4)
      Decrement(x=w4) -> w3
    }
  }
  Array Index(array=$"Steps Status in") -> (out0[w3]=w5)
  # 1: Pass
  # -1: Fail point
  # 0: Previous fail
  # -2: end of step
  # -5: Canceled
  case (w2) {
    frame -2, -1 {
      # force status bar to show full
      Increment(x=w3) -> w9
      w6 = w5
      w7 = 1
      w8 = TRUE
      w10 = -2
    }
    frame Default {
      Property Node(instance in=w5) -> ("Result"=w11, instance out=w12)
      Array Index(array=w1) -> (out0[_]=w13, out1[_]=w14)
      call "Test Hardware Values.gviweb"(Output to DUT=w13, Input from DUT=w14) -> (Pass=w15)
      case (w11) {
        frame "Pass", Default {
          Select(s=w15, t=1, f=-1) -> w10
          w17 = "Pass"  # Step Result
          w18 = "Fail"  # Step Result
          Select(s=w15, t=w17, f=w18) -> w16
        }
        frame "Fail" {
          w16 = w11
          w10 = 0
        }
        frame "Canceled" {
          w16 = w11
          w10 = -5
        }
      }
      Property Node(instance in=w12, "Result"=w16) -> (instance out=w6)
      w7 = w2
      w8 = default
      w9 = w3
    }
  }
  Build Array($"Data from ui", w10) -> w19
  Build Array($"Test Sequence Data in", w19) -> w20
  $"Test Sequence Data out" <- w20
  $"Step Index out" <- w9
  Property Node(instance in=w6, "Progress"=w7, "Complete"=w8) -> (instance out=w21)
  Replace Array Subset(inArray=$"Steps Status in", index=w3, new=w21) -> w22
  case (w2) {
    frame Default {
      w23 = w22
    }
    frame -1 {
      # new step
      disable {
        frame Enabled {
          w23 = w22
        }
        frame Disabled {
          Property Node(instance in="Step Status.gtype" {all zero or empty}, "Progress"=0) -> (instance out=w24)
          Build Array(w22, w24) -> w23
        }
      }
    }
  }
  $"Steps Status out" <- w23
