vi "Calculate Target Value.gviweb"   [G Web Development Software 22.3.0]
inputs:
  "Wave Value": f64, required
outputs:
  "Target": f64
uses:
  WebApp::support::globals.gviweb
diagram:
  call "globals.gviweb"() -> (Globals=w1)
  Property Node(instance in=w1) -> ("Simulated Amplifier Factor"=w2)
  Multiply(w2, $"Wave Value") -> w3
  $Target <- w3
