vi "DUT Model.gviweb"   [G Web Development Software 22.3.0]
inputs:
  "DUT in": f64 = 3, required
outputs:
  "DUT out": f64
uses:
  WebApp::support::globals.gviweb
diagram:
  call "globals.gviweb"() -> (Globals=w1)
  Property Node(instance in=w1) -> ("Simulated Amplifier Factor"=w2, "Simulated Amplifier Noise Amplitude (%)"=w3)
  Multiply($"DUT in", w2) -> w4
  # Noise should be equally positive and negative
  Random Number() -> (number (0 to 1)=w5)
  Subtract(x=w5, y=0.5) -> w6
  Divide(x=w3, y=100) -> w7
  Multiply(w4, w7, w6) -> w8
  # add noise
  Add(w4, w8) -> w9
  $"DUT out" <- w9
