vi "Generate Waveform.gviweb"   [G Web Development Software 22.3.0]
inputs:
  "IO Data": "IO Data.gtype", required
outputs:
  "Time Elapsed": f64
  "Wave Value": f64
  "IO data out": "IO Data.gtype"
  "Fraction Complete": f64
types:
  "Waveforms.gtype" = enum{"Constant", "Sawtooth", "Sinusoid"}
  "IO Data.gtype" = cluster{"Waveform": "Waveforms.gtype", "Duration (s)": f64, "Start Time": timestamp, "Time Factor": f64, "Adjusted Amplitude": f64, "New Wave": bool, "Wave Active": bool, "Fault start time": f64}
diagram:
  Property Node(instance in=$"IO Data") -> ("Waveform"=w1, "Duration (s)"=w2, "Start Time"=w3, "Time Factor"=w4, "Adjusted Amplitude"=w5, instance out=w6)
  # Time elapsed -> wave complete -> switch to inactive
  Get Current Time() -> (current time=w7)
  Timestamp Subtract(x=w7, y=w3) -> w8
  Is Less(x=w8, y=w2) -> w9
  Property Node(instance in=w6, "Wave Active"=w9) -> (instance out=w10)
  $"IO data out" <- w10
  Divide(x=w8, y=w2) -> w11
  $"Fraction Complete" <- w11
  $"Time Elapsed" <- w8
  Multiply(w8, w4) -> w12
  case (w9) {
    frame False, Default {
      w13 = default
    }
    frame True {
      case (w1) {
        frame "Constant" {
          w13 = w5
        }
        frame "Sawtooth" {
          Quotient And Remainder(x=w12, y=w5) -> (x-y*floor(x/y)=w13)
        }
        frame "Sinusoid" {
          Subtract(x=w12, y=w4) -> w14
          # sine goes from 1 to -1
          Sine(x=w14) -> w15
          Add(w15, 1) -> w16
          Multiply(w16, w5) -> w13
        }
      }
    }
  }
  $"Wave Value" <- w13
