vi "Handle Hardware IO.gviweb"   [G Web Development Software 22.3.0]
inputs:
  "IO data in": "IO Data.gtype"
  "Hardware output": f64
  "Time Elapsed": f64
outputs:
  "IO data out": "IO Data.gtype"
  "Hardware input": f64
types:
  "Waveforms.gtype" = enum{"Constant", "Sawtooth", "Sinusoid"}
  "IO Data.gtype" = cluster{"Waveform": "Waveforms.gtype", "Duration (s)": f64, "Start Time": timestamp, "Time Factor": f64, "Adjusted Amplitude": f64, "New Wave": bool, "Wave Active": bool, "Fault start time": f64}
uses:
  WebApp::support::globals.gviweb
diagram:
  Property Node(instance in=$"IO data in") -> ("Wave Active"=w1, instance out=w2)
  case (w1) {
    frame False, Default {
      w3 = w2
      w4 = $"Hardware output"
    }
    frame True {
      disable {
        frame Enabled {
          w5 = $"Hardware output"
        }
        frame Disabled {
          # #Integrate_Hardware
          # Output to DUT goes here
        }
      }
      disable {
        frame Enabled {
          # 0 indicates no fault
          Property Node(instance in=w2) -> ("Fault start time"=w6, instance out=w3)
          Is Not Equal To 0(x=w6) -> w7
          Is Greater Or Equal(x=$"Time Elapsed", y=w6) -> w8
          Logical And(w7, w8) -> w9
          case (w9) {
            frame True {
              w4 = 0
            }
            frame False {
              call "globals.gviweb"() -> (Globals=w10)
              # #simulation - simulate amplifier
              Property Node(instance in=w10) -> ("Simulated Amplifier Factor"=w11)
              Multiply(w5, w11) -> w4
            }
          }
        }
        frame Disabled {
          # #Integrate_Hardware
          # Input/ response from DUT goes here
          w3 = w2
        }
      }
    }
  }
  $"IO data out" <- w3
  $"Hardware input" <- w4
