vi "Initialize Waveform.gviweb"   [G Web Development Software 22.3.0]
inputs:
  "Waveforms": enum{"Constant", "Sawtooth", "Sinusoid"} = "Constant"
  "Frequency": f64 = 3
  "Amplitude": f64
outputs:
  "Time Factor": f64
  "Adjusted Amplitude": f64
diagram:
  case ($Waveforms) {
    frame "Constant", Default {
      w1 = default
      w2 = $Amplitude
    }
    frame "Sawtooth" {
      # w1: Slope
      Multiply($Frequency, $Amplitude) -> w1
      w2 = $Amplitude
    }
    frame "Sinusoid" {
      # w1: radians at 1 second
      Multiply(f64 default, $Frequency) -> w1
      # sine amplitude is 2
      Multiply($Amplitude, 0.5) -> w2
    }
  }
  $"Time Factor" <- w1
  $"Adjusted Amplitude" <- w2
