vi "Prep Next Waveform.gviweb"   [G Web Development Software 22.3.0]
inputs:
  "Test Sequence in": "Test Step Data.gtype"[], required
  "IO Data In": "IO Data.gtype", required
outputs:
  "Test Sequence out": "Test Step Data.gtype"[]
  "IO Data out": "IO Data.gtype"
types:
  "Waveforms.gtype" = enum{"Constant", "Sawtooth", "Sinusoid"}
  "IO Data.gtype" = cluster{"Waveform": "Waveforms.gtype", "Duration (s)": f64, "Start Time": timestamp, "Time Factor": f64, "Adjusted Amplitude": f64, "New Wave": bool, "Wave Active": bool, "Fault start time": f64}
  "Waveform Data.gtype" = cluster{"Waveform": "Waveforms.gtype", "Amplitude": f64, "Frequency": f64}
  "Test Step Data.gtype" = cluster{"Duration (s)": f64, "Waveform Data": "Waveform Data.gtype", "Fault Probability": f64}
uses:
  WebApp::IO::Initialize Waveform.gviweb
diagram:
  Delete From Array(inArray=$"Test Sequence in", index0=0) -> (outArray=w1, deleted=w2)
  $"Test Sequence out" <- w1
  Property Node(instance in=w2) -> ("Duration (s)"=w3, "Waveform Data"=w4, instance out=w5)
  Property Node(instance in=w5) -> ("Duration (s)"=w6, "Fault Probability"=w7)
  disable {
    frame Disabled { }
    frame Enabled {
      Random Number() -> (number (0 to 1)=w9)
      Multiply(w9, 100) -> w10
      Is Greater Or Equal(x=w7, y=w10) -> w11
      # #simulation - simulate fault
      case (w11) {
        frame False, Default {
          # no fault
          w8 = 0
        }
        frame True {
          # ensure fault is at least 20% of step duration and that at least 10% is the normal waveform for better user understanding
          Random Number() -> (number (0 to 1)=w12)
          In Range And Coerce(lower limit=0.2, upper limit=0.9, x=w12) -> (coerced(x)=w13)
          Multiply(w6, w13) -> w14
          # Fault start of 0 indicates no fault, so 100% duration must be avioded
          Subtract(x=w6, y=w14) -> w8
        }
      }
    }
  }
  Property Node(instance in=w4) -> ("Waveform"=w15, "Amplitude"=w16, "Frequency"=w17)
  call "Initialize Waveform.gviweb"(Waveforms=w15, Frequency=w17, Amplitude=w16) -> (Time Factor=w18, Adjusted Amplitude=w19)
  # Tells later logic to save start timestamp just before generating first waveform value
  Property Node(instance in=$"IO Data In", "Waveform"=w15, "Duration (s)"=w3, "Time Factor"=w18, "Adjusted Amplitude"=w19, "New Wave"=TRUE) -> (instance out=w20)
  Property Node(instance in=w20, "Fault start time"=w8) -> (instance out=w21)
  $"IO Data out" <- w21
