vi "Test Hardware Values.gviweb"   [G Web Development Software 22.3.0]
inputs:
  "Output to DUT": f64
  "Input from DUT": f64
outputs:
  "Pass": bool
uses:
  WebApp::support::globals.gviweb
diagram:
  # $"Input from DUT": Actual
  disable {
    frame Disabled {
      # #Integrate_Hardware - create hardware specific evaluation here
    }
    frame Enabled {
      call "globals.gviweb"() -> (Globals=w2)
      Property Node(instance in=w2) -> ("Simulated Amplifier Factor"=w3, "Pass Tolerance (%)"=w4)
      # w5: Target
      Multiply(w3, $"Output to DUT") -> w5
      # Actual within +/- tolerance of target?
      Divide(x=w4, y=100) -> w6
      Multiply(w6, w5) -> w7
      Add(w7, w5) -> w8
      Subtract(x=w5, y=w7) -> w9
      In Range And Coerce(lower limit=w9, upper limit=w8, x=$"Input from DUT") -> (In Range?=w10)
      Is Equal To 0(x=$"Output to DUT") -> w11
      # if both values zero, in rage function above returns false
      Is Equal To 0(x=$"Input from DUT") -> w12
      Logical And(w11, w12) -> w13
      Logical Or(w10, w13) -> w1
    }
  }
  $Pass <- w1
