vi "Monitor Hardware Fault.gviweb"   [G Web Development Software 22.3.0]
inputs:
  "Manager Queue in": Queue<"Message Cluster.gtype">, required
  "Fault in": bool, required
  "Simulate Hardware Fault": bool
  "Error in": error
  "IO data in": "IO Data.gtype", required
outputs:
  "Fault out": bool
  "Manager Queue out": Queue<"Message Cluster.gtype">
  "Error out": error
  "IO data out": "IO Data.gtype"
types:
  "Message Cluster.gtype" = cluster{"Message": string, "Message Data": variant}
  "Waveforms.gtype" = enum{"Constant", "Sawtooth", "Sinusoid"}
  "IO Data.gtype" = cluster{"Waveform": "Waveforms.gtype", "Duration (s)": f64, "Start Time": timestamp, "Time Factor": f64, "Adjusted Amplitude": f64, "New Wave": bool, "Wave Active": bool, "Fault start time": f64}
uses:
  WebApp::support::Message Queue::Enqueue Message (Single).gvi
diagram:
  disable {
    frame Disabled {
      w1 = $"Error in"
      w2 = $"Fault in"
      w3 = $"Manager Queue in"
    }
    frame Enabled {
      # send fault message only once when fault occurs
      Property Node(instance in=$"IO data in", "Wave Active"=FALSE) -> (instance out=w4)
      Logical Or($"Simulate Hardware Fault", $"Fault in") -> w2
      # #Integrate_Hardware
      Logical And($"Simulate Hardware Fault", not $"Fault in") -> w5
      case (w5) {
        frame False, Default {
          w1 = $"Error in"
          w3 = $"Manager Queue in"
        }
        frame True {
          call "Enqueue Message (Single).gvi"(message queue in=$"Manager Queue in", message="Instruction", message data="Hardware Fault", error in=$"Error in") -> (message queue out=w3, error out=w1)
        }
      }
    }
  }
  $"IO data out" <- w4
  $"Fault out" <- w2
  $"Manager Queue out" <- w3
  $"Error out" <- w1
