vi "Prep Step Staus for Display.gviweb"   [G Web Development Software 22.3.0]
inputs:
  "Steps status out": "Step Status.gtype"[]
outputs:
  "Step Status": cluster{"Progress": f64, "Pass": "Color.gtype"}[]
types:
  "Step Result.gtype" = enum{"Pass", "Fail", "Canceled"}
  "Step Status.gtype" = cluster{"Progress": f64, "Result": "Step Result.gtype", "Complete": bool}
  "Color.gtype" = u32
diagram:
  for {
    w1 = each element of $"Steps status out"
    Property Node(instance in=w1) -> ("Progress"=w3, "Result"=w4, "Complete"=w5)
    case (w5) {
      frame False, Default {
        w6 = 4294967295
      }
      frame True {
        case (w4) {
          frame "Pass", Default {
            w6 = 4282038392
          }
          frame "Canceled" {
            w6 = 4294965402
          }
          frame "Fail" {
            w6 = 4293794853
          }
        }
      }
    }
    Build Cluster(w3, w6) -> w7
    append w7 to w2
  }
  $"Step Status" <- w2
