vi "Receive IO Data.gviweb"   [G Web Development Software 22.3.0]
inputs:
  "IO Data Queue": Queue<f64[]>
  "Steps status in": "Step Status.gtype"[]
  "Test data in": f64[][]
  "error in": error
outputs:
  "Test Data for Graph": f64[][]
  "number elements in queue - seen UI": i32
  "Steps status out": "Step Status.gtype"[]
  "error out": error
  "Test data out": f64[][]
types:
  "Step Result.gtype" = enum{"Pass", "Fail", "Canceled"}
  "Step Status.gtype" = cluster{"Progress": f64, "Result": "Step Result.gtype", "Complete": bool}
uses:
  WebApp::Handle IO Data.gviweb
diagram:
  Get Queue Status(error in=$"error in", queue=$"IO Data Queue") -> (# elements in queue=w1, error out=w2, queue out=w3)
  $"number elements in queue - seen UI" <- w1
  s1 = $"Test data in"  # shift register
  s2 = $"Steps status in"  # shift register
  s3 = w2  # shift register
  for (N = w1) {
    Dequeue Element(error in=s3, queue=w3) -> (element=w4, error out=w5)
    call "Handle IO Data.gviweb"(Test Sequence Data in=s1, Steps Status in=s2, Data from ui=w4) -> (Test Sequence Data out=w6, Steps Status out=w7)
    next s1 = w6
    next s2 = w7
    next s3 = w5
  }
  $"Steps status out" <- s2
  $"Test data out" <- s1
  Array Size(array=s1) -> (size(s)=w8)
  Array Index(array=w8) -> (out0[_]=w9)
  s4 = s1  # shift register
  for (N = w9) {
    Array Index(array=s4) -> (out0[_, 0]=w10)
    Array Max And Min(array=w10) -> (min index(es)=w11, min value=w12)
    Is Less Than 0(x=w12) -> w13
    # messages are encoded as negative numbers
    # their packets should be removed before data is graphed
    case (w13) {
      frame False {
        w14 = TRUE
        w15 = s4
      }
      frame True {
        Delete From Array(inArray=s4, index0=w11) -> w15
        w14 = default
      }
    }
    next s4 = w15
    stop if w14
  }
  # excludes time elapsed/ status data
  # row 1: output
  # row 2: input
  Array Subset(array=s4, index1=1, length1=2) -> w16
  Transpose 2D Array(2D array=w16) -> (transposed array=w17)
  $"Test Data for Graph" <- w17
  $"error out" <- s3
