vi "Test Hardware Values.gviweb"   [G Web Development Software 22.3.0]
inputs:
  "Output to DUT": f64
  "Input from DUT": f64
outputs:
  "Pass": bool
uses:
  WebApp::globals.gviweb
diagram:
  call "globals.gviweb"() -> (Globals=w1)
  Property Node(instance in=w1) -> ("Simulated Amplifier Factor"=w2, "Pass Tolerance (%)"=w3)
  # w4: Target
  # $"Input from DUT": Actual
  Multiply(w2, $"Output to DUT") -> w4
  # Actual within +/- tolerance of target?
  Divide(x=w3, y=100) -> w5
  Multiply(w5, w4) -> w6
  Add(w6, w4) -> w7
  Subtract(x=w4, y=w6) -> w8
  In Range And Coerce(lower limit=w8, upper limit=w7, x=$"Input from DUT") -> (In Range?=w9)
  $Pass <- w9
