vi "Append Log Text.gviweb"   [G Web Development Software 22.3.0]
inputs:
  "Message Queues in": Queue<"Message Cluster.gtype">[], required
  "Update Tex": string, required
  "Error in": error
outputs:
  "Error out_2": error
  "Message Queues out": Queue<"Message Cluster.gtype">[]
types:
  "Message Cluster.gtype" = cluster{"Message": string, "Message Data": variant}
uses:
  WebApp::support::Message Queue::Enqueue Message (Single).gvi
diagram:
  $"Message Queues out" <- $"Message Queues in"
  Array Index(array=$"Message Queues in") -> (out0["UI"]=w1)
  call "Enqueue Message (Single).gvi"(message queue in=w1, message="Update Status", message data=$"Update Tex", error in=$"Error in") -> (error out=w2)
  $"Error out_2" <- w2
