vi "Send Sequence Complete UI Updates.gviweb"   [G Web Development Software 22.3.0]
inputs:
  "Current State": "Manager State.gtype" = "Idle"
  "Input": Queue<"Message Cluster.gtype">[]
  "Error In": error
outputs:
  "Error out": error
types:
  "Manager State.gtype" = enum{"Idle", "Initialize", "Execute", "Finalize"}
  "Message Cluster.gtype" = cluster{"Message": string, "Message Data": variant}
uses:
  WebApp::support::Message Queue::Enqueue Message (Single).gvi
  WebApp::UI messages::Append Log Text.gviweb
diagram:
  Format Into String(formatString="%s Complete", errIn=$"Error In", $"Current State") -> (outString=w1, errOut=w2)
  Array Index(array=$Input) -> (out0["UI"]=w3)
  call "Enqueue Message (Single).gvi"(message queue in=w3, message=w1, error in=w2) -> (error out=w4)
  call "Append Log Text.gviweb"(Input=$Input, resulting string=w1, error out=w4) -> (Output_2=w5)
  $"Error out" <- w5
