vi "Update Program Status.gviweb"   [G Web Development Software 22.3.0]
inputs:
  "Status": string, required
  "Message Queues in": Queue<"Message Cluster.gtype">[], required
  "Error in": error
outputs:
  "Error out": error
  "Message Queues out": Queue<"Message Cluster.gtype">[]
types:
  "Message Cluster.gtype" = cluster{"Message": string, "Message Data": variant}
uses:
  WebApp::support::Message Queue::Enqueue Message (Single).gvi
diagram:
  $"Message Queues out" <- $"Message Queues in"
  Array Index(array=$"Message Queues in") -> (out0["UI"]=w1)
  call "Enqueue Message (Single).gvi"(message queue in=w1, message="Update Program Status", message data=$Status, error in=$"Error in") -> (error out=w2)
  $"Error out" <- w2
