vi "Calculate Test Duration.gviweb"   [G Web Development Software 22.3.0]
inputs:
  "Test Sequences": "Test Step Data.gtype"[]
outputs:
  "Total Duration (s)": f64
types:
  "Waveforms.gtype" = enum{"Constant", "Sawtooth", "Sinusoid"}
  "Waveform Data.gtype" = cluster{"Waveform": "Waveforms.gtype", "Amplitude": f64, "Frequency": f64}
  "Test Step Data.gtype" = cluster{"Duration (s)": f64, "Waveform Data": "Waveform Data.gtype", "Fault Probability": f64}
uses:
  WebApp::support::globals.gviweb
diagram:
  for {
    w1 = each element of $"Test Sequences"
    Property Node(instance in=w1) -> ("Duration (s)"=w3)
    append w3 to w2
  }
  call "globals.gviweb"() -> (Globals=w4)
  Property Node(instance in=w4) -> ("Hardware Initialize Duration (s)"=w5, "Hardware Finalize Duration (s)"=w6)
  Build Array(w2, w5, w6) -> w7
  # Initialize and finalize duration shouldn't vary and will always be executed as part of test sequence
  Add Array Elements(numeric array=w7) -> (sum=w8)
  $"Total Duration (s)" <- w8
