vi "Handle Data Remaining in Queue.gviweb"   [G Web Development Software 22.3.0]
inputs:
  "Graph reference": "Graph reference"[][], required
  "UI Data in": "UI Data.gtype", required
  "Step Status reference": "ArrayViewer reference", required
  "error in": error
  "Test Data queue": Queue<f64[]>, required
outputs:
  "UI Data out": "UI Data.gtype"
  "error out": error
types:
  "Step Result.gtype" = enum{"Pass", "Fail", "Canceled"}
  "Step Status.gtype" = cluster{"Progress": f64, "Result": "Step Result.gtype", "Complete": bool}
  "UI Data.gtype" = cluster{"Step Index": i32, "Test Steps": i32, "Steps Statuses": "Step Status.gtype"[], "Test Data": f64[][], "Dequeue Timeout": i32, "Program Log Text": string}
uses:
  WebApp::UI::IO Data::Receive IO Data.gviweb
  WebApp::UI::Prep Step Staus for Display.gviweb
diagram:
  call "Receive IO Data.gviweb"(UI Data in=$"UI Data in", error in=$"error in", IO Data Queue=$"Test Data queue") -> (UI Data out=w1, error out=w2, Test Data for Graph=w3)
  Property Node(instance in=w1) -> ("Steps Statuses"=w4, instance out=w5)
  $"UI Data out" <- w5
  Property Node(instance in=$"Graph reference", "Value"=w3, error in=w2) -> (error out=w6, instance out=w7)
  Close Reference(error in=w6, reference=w7) -> (error out=w8)
  call "Prep Step Staus for Display.gviweb"(Steps Status=w4) -> (Step Status for Display=w9)
  Property Node(instance in=$"Step Status reference", "Value"=w9, error in=w2) -> (error out=w10, instance out=w11)
  Close Reference(error in=w10, reference=w11) -> (error out=w12)
  Merge Errors(w8, w12) -> (error out=w13)
  $"error out" <- w13
