vi "Handle IO Data.gviweb"   [G Web Development Software 22.3.0]
inputs:
  "Steps Status in": "Step Status.gtype"[], required
  "Data from ui": f64[], required
  "Test Sequence Data in": f64[][], required
  "Step Index in": i32, required
outputs:
  "Steps Status out": "Step Status.gtype"[]
  "Test Sequence Data out": f64[][]
  "Step Index out": i32
types:
  "Step Result.gtype" = enum{"Pass", "Fail", "Canceled"}
  "Step Status.gtype" = cluster{"Progress": f64, "Result": "Step Result.gtype", "Complete": bool}
uses:
  WebApp::IO::Test Hardware Values.gviweb
diagram:
  # extract progress/ status data
  Delete From Array(inArray=$"Data from ui", index0=0) -> (outArray=w1, deleted=w2)
  Array Index(array=$"Steps Status in") -> (out0[$"Step Index in"]=w3)
  # 1: Pass
  # -1: Fail point
  # 0: Previous fail
  # -2: end of step
  # -5: Canceled
  case (w2) {
    frame -2, -1 {
      # force status bar to show full
      Increment(x=$"Step Index in") -> w7
      w4 = w3
      w5 = 1
      w6 = TRUE
      w8 = -2
    }
    frame Default {
      Property Node(instance in=w3) -> ("Result"=w9, instance out=w10)
      Array Index(array=w1) -> (out0[_]=w11, out1[_]=w12)
      call "Test Hardware Values.gviweb"(Output to DUT=w11, Input from DUT=w12) -> (Pass=w13)
      case (w9) {
        frame "Pass", Default {
          Select(s=w13, t=1, f=-1) -> w8
          w15 = "Pass"  # Step Result
          w16 = "Fail"  # Step Result
          Select(s=w13, t=w15, f=w16) -> w14
        }
        frame "Fail" {
          w14 = w9
          w8 = 0
        }
        frame "Canceled" {
          w14 = w9
          w8 = -5
        }
      }
      Property Node(instance in=w10, "Result"=w14) -> (instance out=w4)
      w5 = w2
      w6 = default
      w7 = $"Step Index in"
    }
  }
  Build Array($"Data from ui", w8) -> w17
  Build Array($"Test Sequence Data in", w17) -> w18
  $"Test Sequence Data out" <- w18
  $"Step Index out" <- w7
  Property Node(instance in=w4, "Progress"=w5, "Complete"=w6) -> (instance out=w19)
  Replace Array Subset(inArray=$"Steps Status in", index=$"Step Index in", new=w19) -> w20
  case (w2) {
    frame Default {
      w21 = w20
    }
    frame -1 {
      # new step
      disable {
        frame Enabled {
          w21 = w20
        }
        frame Disabled {
          Property Node(instance in="Step Status.gtype" {all zero or empty}, "Progress"=0) -> (instance out=w22)
          Build Array(w20, w22) -> w21
        }
      }
    }
  }
  $"Steps Status out" <- w21
