vi "Receive IO Data.gviweb"   [G Web Development Software 22.3.0]
inputs:
  "IO Data Queue": Queue<f64[]>, required
  "UI Data in": "UI Data.gtype", required
  "error in": error
outputs:
  "Test Data for Graph": f64[][]
  "number elements in queue - seen UI": i32
  "UI Data out": "UI Data.gtype"
  "error out": error
types:
  "Step Result.gtype" = enum{"Pass", "Fail", "Canceled"}
  "Step Status.gtype" = cluster{"Progress": f64, "Result": "Step Result.gtype", "Complete": bool}
  "UI Data.gtype" = cluster{"Step Index": i32, "Test Steps": i32, "Steps Statuses": "Step Status.gtype"[], "Test Data": f64[][], "Dequeue Timeout": i32, "Program Log Text": string}
uses:
  WebApp::UI::IO Data::Handle IO Data.gviweb
diagram:
  Property Node(instance in=$"UI Data in") -> ("Step Index"=w1, "Test Data"=w2, "Steps Statuses"=w3, instance out=w4)
  Get Queue Status(error in=$"error in", queue=$"IO Data Queue") -> (# elements in queue=w5, error out=w6, queue out=w7)
  # Process all elements in queue
  s1 = w2  # shift register
  s2 = w3  # shift register
  s3 = w6  # shift register
  s4 = w1  # shift register
  for (N = w5) {
    Dequeue Element(error in=s3, queue=w7) -> (element=w8, error out=w9)
    call "Handle IO Data.gviweb"(Test Sequence Data in=s1, Steps Status in=s2, Data from ui=w8, Step Index in=s4) -> (Test Sequence Data out=w10, Steps Status out=w11, Step Index out=w12)
    next s1 = w10
    next s2 = w11
    next s3 = w9
    next s4 = w12
  }
  Property Node(instance in=w4, "Step Index"=s4, "Test Data"=s1, "Steps Statuses"=s2) -> (instance out=w13)
  $"UI Data out" <- w13
  $"number elements in queue - seen UI" <- w5
  Array Size(array=s1) -> (size(s)=w14)
  Array Index(array=w14) -> (out0[_]=w15)
  # Prep data for graph
  s5 = s1  # shift register
  for (N = w15) {
    Array Index(array=s5) -> (out0[_, 0]=w16)
    Array Max And Min(array=w16) -> (min index(es)=w17, min value=w18)
    Is Less Than 0(x=w18) -> w19
    # messages are encoded as negative numbers
    # their packets should be removed before data is graphed
    case (w19) {
      frame False {
        w20 = TRUE
        w21 = s5
      }
      frame True {
        Delete From Array(inArray=s5, index0=w17) -> w21
        w20 = default
      }
    }
    next s5 = w21
    stop if w20
  }
  # excludes time elapsed/ status data
  # excludes evaluation results
  # row 1: target
  # row 2: actual
  Array Subset(array=s5, index1=1, length1=2) -> w22
  Transpose 2D Array(2D array=w22) -> (transposed array=w23)
  $"Test Data for Graph" <- w23
  $"error out" <- s3
