vi "Send Sequence Complete UI Updates.gviweb"   [G Web Development Software 22.3.0]
inputs:
  "Current State": "Manager State.gtype" = "Idle", required
  "Message queues in": Queue<"Message Cluster.gtype">[], required
  "Error In": error
outputs:
  "Error out": error
  "Message queues out": Queue<"Message Cluster.gtype">[]
types:
  "Manager State.gtype" = enum{"Idle", "Initialize", "Execute", "Finalize", "Cancel", "Error"}
  "Message Cluster.gtype" = cluster{"Message": string, "Message Data": variant}
uses:
  WebApp::support::Message Queue::Enqueue Message (Single).gvi
  WebApp::UI::Messages::Append Log Text.gviweb
diagram:
  Format Into String(formatString="%s Complete", errIn=$"Error In", $"Current State") -> (outString=w1, errOut=w2)
  Array Index(array=$"Message queues in") -> (out0["UI"]=w3)
  call "Enqueue Message (Single).gvi"(message queue in=w3, message=w1, error in=w2) -> (error out=w4)
  call "Append Log Text.gviweb"(Message Queues in=$"Message queues in", Update Tex=w1, Error in=w4) -> (Message Queues out=w5, Error out_2=w6)
  $"Message queues out" <- w5
  $"Error out" <- w6
