vi "Prep Step Staus for Display.gviweb"   [G Web Development Software 22.3.0]
inputs:
  "Steps Status": "Step Status.gtype"[], required
outputs:
  "Step Status for Display": T1[]
types:
  "Step Result.gtype" = enum{"Pass", "Fail", "Canceled"}
  "Step Status.gtype" = cluster{"Progress": f64, "Result": "Step Result.gtype", "Complete": bool}
  "Color.gtype" = u32
  T1 = cluster{"Progress": f64, "Result": "Color.gtype"}
uses:
  WebApp::UI::Get Result Color.gviweb
diagram:
  for {
    w1 = each element of $"Steps Status"
    Property Node(instance in=w1) -> ("Progress"=w3, "Result"=w4, "Complete"=w5)
    # Case structure needed to show cancel color as soon as cancel is pressed, meaning while step is still incomplete
    case (w5) {
      frame False, Default {
        case (w4) {
          frame "Canceled" {
            call "Get Result Color.gviweb"(Input=w4) -> (Output=w6)
          }
          frame Default {
            # Don't show result until step complete
            w6 = 4294967295
          }
        }
      }
      frame True {
        call "Get Result Color.gviweb"(Input=w4) -> (Output=w6)
      }
    }
    Build Cluster(w3, w6) -> w7
    append w7 to w2
  }
  $"Step Status for Display" <- w2
