vi "Validate Test Sequence.gviweb"   [G Web Development Software 22.3.0]
inputs:
  "Test Sequence Reference in": "ArrayViewer reference", required
  "UI Queue": Queue<"Message Cluster.gtype">, required
  "Test Sequence": "Test Step Data.gtype"[], required
  "error in": error
outputs:
  "Error out": error
  "Test Sequence Reference out": "ArrayViewer reference"
types:
  "Waveforms.gtype" = enum{"Constant", "Sawtooth", "Sinusoid"}
  "Waveform Data.gtype" = cluster{"Waveform": "Waveforms.gtype", "Amplitude": f64, "Frequency": f64}
  "Test Step Data.gtype" = cluster{"Duration (s)": f64, "Waveform Data": "Waveform Data.gtype", "Fault Probability": f64}
  "Message Cluster.gtype" = cluster{"Message": string, "Message Data": variant}
uses:
  WebApp::support::Message Queue::Enqueue Message (Single).gvi
diagram:
  # Ensures test sequence is valid for execution by checking user input
  s1 = FALSE  # shift register
  for {
    w1 = each element of $"Test Sequence"
    Property Node(instance in=w1) -> ("Waveform Data:Waveform"=w3, instance out=w4)
    case (w3) {
      frame "Constant" {
        w5 = w4
        w6 = s1
      }
      frame Default {
        Property Node(instance in=w4) -> ("Waveform Data:Frequency"=w7, instance out=w8)
        Is Equal To 0(x=w7) -> w9
        # Waveforms aside from Constant must have nonzero frequency to function
        case (w9) {
          frame False {
            w6 = s1
            w5 = w8
          }
          frame True {
            # Force frequency to 1
            Property Node(instance in=w8, "Waveform Data:Frequency"=1) -> (instance out=w5)
            w6 = TRUE
          }
        }
      }
    }
    append w5 to w2
    next s1 = w6
  }
  case (s1) {
    frame False, Default {
      w10 = $"error in"
      w11 = $"Test Sequence Reference in"
    }
    frame True {
      # Notify user frequency has been forced to 1
      w12 = """-------------------------
Frequency value of non-constant waveforms must be non-zero. Coerced to 1.
-------------------------"""
      Property Node(instance in=$"Test Sequence Reference in", "Value"=w2, error in=$"error in") -> (error out=w13, instance out=w11)
      call "Enqueue Message (Single).gvi"(message queue in=$"UI Queue", message="Update Status", message data=w12, error in=w13) -> (error out=w10)
    }
  }
  $"Test Sequence Reference out" <- w11
  $"Error out" <- w10
