vi "Append String Control.gviweb"   [G Web Development Software 22.3.0]
inputs:
  "string control": "StringControl reference", required
  "new string": string = "Manager Exit"
  "error in": error
outputs:
  "error out": error
diagram:
  # #Debug
  Property Node(instance in=$"string control", error in=$"error in") -> ("Value"=w1, error out=w2, instance out=w3)
  Format Into String(formatString="%s\n%s", errIn=w2, w1, $"new string") -> (outString=w4, errOut=w5)
  Property Node(instance in=w3, "Value"=w4, error in=w5) -> (error out=w6, instance out=w7)
  Close Reference(error in=w6, reference=w7) -> (error out=w8)
  $"error out" <- w8
