vi "Check Test Sequence Complete.gviweb"   [G Web Development Software 22.3.0]
inputs:
  "Test Sequence in": "Test Step Data.gtype"[], required
  "IO data in": "IO Data.gtype", required
  "Fraction Complete": f64, required
  "Manager Queue": Queue<"Message Cluster.gtype">, required
  "Error in": error
  "This Queue Name": "Message Queue Names.gtype" = "Manager", required
outputs:
  "Test Sequence out": "Test Step Data.gtype"[]
  "Test Sequence Complete": bool
  "IO data out": "IO Data.gtype"
  "Fraction Complete (includes messages)": f64
  "Error out": error
types:
  "Waveforms.gtype" = enum{"Constant", "Sawtooth", "Sinusoid"}
  "IO Data.gtype" = cluster{"Waveform": "Waveforms.gtype", "Duration (s)": f64, "Start Time": timestamp, "Time Factor": f64, "Adjusted Amplitude": f64, "New Wave": bool, "Wave Active": bool, "Fault start time": f64}
  "Waveform Data.gtype" = cluster{"Waveform": "Waveforms.gtype", "Amplitude": f64, "Frequency": f64}
  "Test Step Data.gtype" = cluster{"Duration (s)": f64, "Waveform Data": "Waveform Data.gtype", "Fault Probability": f64}
  "Message Cluster.gtype" = cluster{"Message": string, "Message Data": variant}
  "Message Queue Names.gtype" = enum{"Manager", "UI", "IO"}
uses:
  WebApp::program instructions::Report Step Complete.gviweb
  WebApp::IO::Prep Next Waveform.gviweb
diagram:
  Property Node(instance in=$"IO data in") -> ("Wave Active"=w1, instance out=w2)
  case (w1) {
    frame True {
      w3 = $"Test Sequence in"
      w4 = w2
      w5 = $"Fraction Complete"
      w6 = default
      w7 = $"Error in"
    }
    frame False {
      Array Size(array=$"Test Sequence in") -> (size(s)=w8)
      # Waveform complete
      case (w8) {
        frame 0 {
          # Test sequence complete
          call "Report Step Complete.gviweb"(Manager Queue=$"Manager Queue", This Queue Name=$"This Queue Name", Step Name="Execute", Error in=$"Error in") -> (Error out=w7)
          w3 = $"Test Sequence in"
          w4 = w2
          w5 = -2
          w6 = TRUE
        }
        frame Default {
          # Start next waveform
          call "Prep Next Waveform.gviweb"(Test Sequence in=$"Test Sequence in", IO Data In=w2) -> (Test Sequence out=w3, IO Data out=w9)
          Property Node(instance in=w9, "Wave Active"=TRUE) -> (instance out=w4)
          w5 = -1
          w6 = default
          w7 = $"Error in"
        }
      }
    }
  }
  # -1: New wave
  # -2: Test sequences complete
  $"Test Sequence out" <- w3
  $"IO data out" <- w4
  $"Fraction Complete (includes messages)" <- w5
  $"Test Sequence Complete" <- w6
  $"Error out" <- w7
