vi "Reached Status.gviweb"   [G Web Development Software 22.3.0]
inputs:
  "Point": string = "UI Initialize"
  "string control": "StringControl reference", required
  "Input": error
outputs:
  "Output_2": error
uses:
  WebApp::development::Append String Control.gviweb
diagram:
  Format Into String(formatString="REACHED: %s", errIn=$Input, $Point) -> (outString=w1, errOut=w2)
  # #debug
  call "Append String Control.gviweb"(string control=$"string control", new string=w1, error in=w2) -> (error out=w3)
  $Output_2 <- w3
