vi "Waveform VIs test.gviweb"   [G Web Development Software 22.3.0]
panel controls:
  "Test Sequence": T2[]
  "stop": bool
panel indicators:
  "Time Elapsed": f64
  "Done": bool
  "Graph": f64[][]
  "Step Status": f64[]
types:
  T1 = cluster{"Waveform": enum{"Constant", "Sawtooth", "Sinusoid"}, "Amplitude": f64, "Frequency": f64}
  T2 = cluster{"Duration (s)": f64, "Waveform Data": T1, "Fault Probability": f64}
  "Waveforms.gtype" = enum{"Constant", "Sawtooth", "Sinusoid"}
  "IO Data.gtype" = cluster{"Waveform": "Waveforms.gtype", "Duration (s)": f64, "Start Time": timestamp, "Time Factor": f64, "Adjusted Amplitude": f64, "New Wave": bool, "Wave Active": bool, "Fault start time": f64}
uses:
  WebApp::IO::Handle Next Waveform.gviweb
  WebApp::IO::Generate Waveform.gviweb
  WebApp::development::Check Test Sequence Complete.gviweb
  WebApp::IO::Handle Hardware IO.gviweb
  WebApp::debug::Handle IO Data.gviweb
diagram:
  Property Node(instance in=reference to "Done", "Value"=FALSE) -> (error out=w1)
  call "Handle Next Waveform.gviweb"(Test Sequence in=$"Test Sequence", IO Data In="IO Data.gtype" {all zero or empty}) -> (Test Sequence out=w2, IO Data out=w3)
  s1 = w3  # shift register
  s2 = w2  # shift register
  s3 = f64[][] []  # shift register
  s4 = [0]  # shift register
  while (after w1) {
    Property Node(instance in=s1) -> ("Wave Active"=w4, instance out=w5)
    case (w4) {
      frame False, Default {
        w6 = w5
        w7 = s2
        w8 = s3
        w9 = s4
      }
      frame True {
        Property Node(instance in=w5) -> ("New Wave"=w10, instance out=w11)
        case (w10) {
          frame False, Default {
            w12 = w11
          }
          frame True {
            Get Current Time() -> (current time=w13)
            # only save init timestamp at wave start
            Property Node(instance in=w11, "Start Time"=w13, "New Wave"=FALSE) -> (instance out=w12)
          }
        }
        call "Generate Waveform.gviweb"(IO Data=w12) -> (Time Elapsed=w14, IO data out=w15, Wave Value=w16, Fraction Complete=w17)
        call "Check Test Sequence Complete.gviweb"(Test Sequence in=s2, IO data in=w15, Fraction Complete=w17) -> (Test Sequence out=w7, IO data out=w18, Fraction Complete (includes messages)=w19, Test Sequence Complete=w20)
        $Done <- w20
        call "Handle Hardware IO.gviweb"(IO data in=w18, Hardware output=w16, Time Elapsed=w14) -> (IO data out=w6, Hardware input=w21)
        Build Array(w19, w16, w21) -> w22
        call "Handle IO Data.gviweb"(Test Sequence Data in=s3, Steps Status in=s4, Data from ui=w22) -> (Test Sequence Data out=w8, Steps Status out=w9, Data for display=w23)
        $"Step Status" <- w9
        $"Time Elapsed" <- w14
        $Graph <- w23
      }
    }
    Wait(time to wait=50)
    next s1 = w6
    next s2 = w7
    next s3 = w8
    next s4 = w9
    stop if $stop
  }
