vi "waveform test.gviweb"   [G Web Development Software 22.3.0]
panel controls:
  "stop": bool
  "Amplitude": f64
  "Duration (s)": f64
  "Frequency": f64 = 3
  "Waveforms": enum{"Constant", "Sawtooth", "Sinusoid"} = "Constant"
panel indicators:
  "Time Elapsed": f64
  "size(s)": i32[]
  "Graph_2": f64[]
  "Output": f64[][]
  "Output_2": f64[]
  "size(s)_2": i32
  "subarray": f64[]
  "max value": f64
  "min value": f64
uses:
  WebApp::IO::Initialize Waveform.gviweb
diagram:
  w1 = $Waveforms
  call "Initialize Waveform.gviweb"(Waveforms=w1, Frequency=$Frequency, Amplitude=$Amplitude) -> (Time Factor=w2, Adjusted Amplitude=w3)
  w4 = $"Duration (s)"
  w5 = 50  # sample rate (ms)
  sequence {
    frame 0 {
      Get Current Time() -> (current time=w6)
    }
  }
  s1 = uninitialised  # shift register
  s2 = uninitialised  # shift register
  while {
    Get Current Time() -> (current time=w7)
    Timestamp Subtract(x=w7, y=w6) -> w8
    $"Time Elapsed" <- w8
    Is Greater Or Equal(x=w8, y=w4) -> w9
    Multiply(w8, w2) -> w10
    case (w1) {
      frame "Constant" {
        w11 = w3
      }
      frame "Sawtooth" {
        Quotient And Remainder(x=w10, y=w3) -> (x-y*floor(x/y)=w11)
      }
      frame "Sinusoid" {
        Sine(x=w10) -> w12
        Add(w12, 1) -> w13
        Multiply(w13, w3) -> w11
      }
    }
    Build Array(s2, w11) -> w14
    $Graph_2 <- w14
    disable {
      frame Disabled { }
      frame Enabled {
        Build Array(w8, w10, w11) -> w16
        Build Array(s1, w16) -> w15
      }
    }
    disable {
      frame Enabled {
        Wait(time to wait=w5)
      }
      frame Disabled {
        Wait Until Next Multiple(multiple to wait=w5)
      }
    }
    next s1 = w15
    next s2 = w14
    stop if w9
  }
  sequence {
    frame 0 {
      $Output <- s1
      Array Size(array=s1) -> (size(s)=w17)
      Transpose 2D Array(2D array=s1) -> (transposed array=w18)
      Array Index(array=w18) -> (out0[_, _]=w19)
      Array Size(array=w19) -> (size(s)=w20)
      Decrement(x=w20) -> w21
      for (N = w21) (iteration -> i1) {
        Array Index(array=w19) -> (out0[i1]=w23, out1[_]=w24)
        Subtract(x=w24, y=w23) -> w25
        append w25 to w22
      }
      Delete From Array(inArray=w22, index0=0) -> w26
      Array Max And Min(array=w26) -> (max value=w27, min value=w28)
      $"max value" <- w27
      $"min value" <- w28
      $subarray <- w19
      $Output_2 <- w22
      $"size(s)_2" <- w20
    }
  }
  while {
    Wait(time to wait=500)
    $"size(s)" <- w17
    stop if $stop
  }
