vi "index.gviweb"   [G Web Development Software 22.3.0]
panel controls:
  "Exit (development only)": bool
  "Test Start": bool
  "Test Steps": T3[]
  "Cancel": bool
panel indicators:
  "Test Duration (s)": f64
  "Step Status": T1[]
  "Program Log": string
  "Program Status": string
  "Initialized": bool
  "Finalized": bool
  "Graph": f64[][]
  "Result": bool
types:
  "Color.gtype" = u32
  T1 = cluster{"Progress": f64, "Result": "Color.gtype"}
  T2 = cluster{"Stimulus": enum{"Constant", "Sawtooth", "Sinusoid"}, "Amplitude": f64, "Frequency": f64}
  T3 = cluster{"Duration (s)": f64, "Waveform Data": T2, "Fault Probability": f64}
  "Step Result.gtype" = enum{"Pass", "Fail", "Canceled"}
  "Step Status.gtype" = cluster{"Progress": f64, "Result": "Step Result.gtype", "Complete": bool}
  "UI Data.gtype" = cluster{"Step Index": i32, "Test Steps": i32, "Steps Statuses": "Step Status.gtype"[], "Test Data": f64[][], "Dequeue Timeout": i32, "Program Log Text": string}
  "Waveforms.gtype" = enum{"Constant", "Sawtooth", "Sinusoid"}
  "Waveform Data.gtype" = cluster{"Waveform": "Waveforms.gtype", "Amplitude": f64, "Frequency": f64}
  "Test Step Data.gtype" = cluster{"Duration (s)": f64, "Waveform Data": "Waveform Data.gtype", "Fault Probability": f64}
  "IO Data.gtype" = cluster{"Waveform": "Waveforms.gtype", "Duration (s)": f64, "Start Time": timestamp, "Time Factor": f64, "Adjusted Amplitude": f64, "New Wave": bool, "Wave Active": bool, "Fault start time": f64}
  "Manager State.gtype" = enum{"Idle", "Initialize", "Execute", "Finalize", "Cancel", "Error"}
  "Message Queue Names.gtype" = enum{"Manager", "UI", "IO"}
  "Step Data.gtype" = cluster{"Message Queue": "Message Queue Names.gtype", "Action": string}
  "Sequence.gtype" = cluster{"Manager State": "Manager State.gtype", "Steps": "Step Data.gtype"[]}
  "Manager Data.gtype" = cluster{"Current State": "Manager State.gtype", "Current Step": "Step Data.gtype", "Remaining Steps": "Step Data.gtype"[], "Remaining Sequences": "Sequence.gtype"[], "Current Instruction": string}
  "Error Data.gtype" = cluster{"Error Origin": "Message Queue Names.gtype", "Error In": error}
uses:
  WebApp::support::Message Queue::Create All Message Queues.gvi
  WebApp::support::Message Queue::Dequeue Message.gvi
  WebApp::UI::Define Preset Test Sequence.gviweb
  WebApp::UI::Validate Test Sequence.gviweb
  WebApp::UI::Calculate Test Duration.gviweb
  WebApp::UI::Prep Step Staus for Display.gviweb
  WebApp::program instructions::Report Step Complete.gviweb
  WebApp::UI::IO Data::Handle Data Remaining in Queue.gviweb
  WebApp::UI::Get Result Color.gviweb
  WebApp::UI::IO Data::Receive IO Data.gviweb
  WebApp::support::globals.gviweb
  WebApp::support::Generate Undefined Message Error.gviweb
  WebApp::support::Handle Error.gviweb
  WebApp::IO::Prep Next Waveform.gviweb
  WebApp::IO::Generate Waveform.gviweb
  WebApp::IO::Handle Hardware IO.gviweb
  WebApp::development::Check Test Sequence Complete.gviweb
  WebApp::IO::Calculate Target Value.gviweb
  WebApp::program instructions::Define Program Instructions.gviweb
  WebApp::support::Message Queue::Enqueue Message (Single).gvi
  WebApp::UI::Messages::Append Log Text.gviweb
  WebApp::program instructions::Handle Next Sequence.gviweb
  WebApp::program instructions::Handle Next Step.gviweb
  NI::G Core::Error::Build Error Cluster.gvi
  WebApp::UI::Messages::Send Sequence Complete UI Updates.gviweb
  WebApp::UI::Messages::Update Program Status.gviweb
  WebApp::support::Error Handler - Event Handling Loop.gvi
diagram:
  # #development
  # #build
  Property Node(instance in=reference to "Exit (development only)", "Visible"=FALSE) -> (error out=w1)
  w2 = bool FALSE  # Stop Event
  Create User Event[EventName="Stop Event"](error in=w1, user event data type=w2) -> (error out=w3, user event out=w4)
  Obtain Queue(element data type=f64[] [], name="Test Data") -> (error out=w5, queue out=w6)
  w7 = ["Manager", "UI", "IO"]  # Queue List
  Array Size(array=w7) -> (size(s)=w8)
  call "Create All Message Queues.gvi"(Loop Count=w8, error in=w3) -> (Message Queues=w9, error out=w10)
  Array Index(array=w9) -> (out0["Manager"]=w11, out1["UI"]=w12)
  Merge Errors(w10, w5) -> (error out=w13)
  s1 = uninitialised  # shift register
  while {
    # "UI": UI Name
    # w11: Manager
    Property Node(instance in=s1) -> ("Dequeue Timeout"=w14, instance out=w15)
    # w6: Test Data
    call "Dequeue Message.gvi"(message queue in=w12, timeout in milliseconds=w14, error in=w13) -> (timed out?=w16, message queue out=w17, message=w18, message data=w19, error out=w20)
    # UI Update Loop
    case (w18) ignore case {  # Message Cases
      frame "SW Init" {
        call "Define Preset Test Sequence.gviweb"() -> (Preset Test Sequence=w24)
        Array Size(array=w24) -> (size(s)=w25)
        Initialize Array(element="Step Status.gtype" {all zero or empty}, size=w25) -> w26
        Property Node(instance in="UI Data.gtype" {all zero or empty}, "Step Index"=0, "Test Steps"=w25, "Steps Statuses"=w26, "Test Data"=f64[][] [], "Dequeue Timeout"=-1, "Program Log Text"="") -> (instance out=w23)
        Build Array(reference to "Finalized", reference to "Initialized") -> w27
        for {
          w28 = each element of w27
          Property Node(instance in=w28, "Value"=FALSE, error in=w20) -> (error out=w31, instance out=w32)
          append w31 to w29
          append w32 to w30
        }
        Property Node(instance in=reference to "Result", "Value"=FALSE, "Text"=[" ", " "], error in=w20) -> (error out=w33, instance out=w34)
        Property Node(instance in=reference to "Test Steps", "Disabled"=FALSE, error in=w20) -> (error out=w35, instance out=w36)
        Property Node(instance in=reference to "Program Status", "Value"="Idle", error in=w20) -> (error out=w37, instance out=w38)
        Property Node(instance in=reference to "Program Log", "Value"="", error in=w20) -> (error out=w39, instance out=w40)
        Property Node(instance in=reference to "Test Steps", "Value"=w24, error in=w20) -> (error out=w41, instance out=w42)
        call "Validate Test Sequence.gviweb"(Test Sequence Reference in=w42, UI Queue=w17, Test Sequence=w24, error in=w41) -> (Test Sequence Reference out=w43, Error out=w44)
        Merge Errors(w33, w35, w37, w39, w29, w44) -> (error out=w45)
        call "Calculate Test Duration.gviweb"(Test Sequences=w24) -> (Total Duration (s)=w46)
        Property Node(instance in=reference to "Test Duration (s)", "Value"=w46, error in=w45) -> (error out=w47, instance out=w48)
        call "Prep Step Staus for Display.gviweb"(Steps Status=w26) -> (Step Status for Display=w49)
        Property Node(instance in=reference to "Step Status", "Value"=w49, error in=w45) -> (error out=w50, instance out=w51)
        Build Array(w34, w36, w38, w40, w30, w43) -> w52
        Build Array(w52, w51, w48) -> w53
        for {
          w54 = each element of w53
          Close Reference(reference=w54) -> (error out=w56)
          append w56 to w55
        }
        Merge Errors(w55, w45, w50, w47) -> (error out=w21)
        w22 = default
      }
      frame "Handle Test Change" {
        Variant To Data(error in (no error)=w20, type="Test Step Data.gtype"[] [], variant=w19) -> (data=w57, error out=w58)
        Array Size(array=w57) -> (size(s)=w59)
        Property Node(instance in=w15, "Test Steps"=w59) -> (instance out=w23)
        call "Calculate Test Duration.gviweb"(Test Sequences=w57) -> (Total Duration (s)=w60)
        $"Test Duration (s)" <- w60
        call "Validate Test Sequence.gviweb"(Test Sequence Reference in=reference to "Test Steps", UI Queue=w17, Test Sequence=w57, error in=w58) -> (Test Sequence Reference out=w61, Error out=w62)
        Close Reference(error in=w62, reference=w61) -> (error out=w21)
        w22 = default
      }
      frame "Execute" {
        # start polling to process data from IO loop
        Property Node(instance in=w15, "Dequeue Timeout"=0) -> (instance out=w23)
        call "Report Step Complete.gviweb"(Manager Queue=w11, This Queue Name="UI", Step Name=w18, Error in=w20) -> (Error out=w21)
        w22 = default
      }
      frame "Update Status" {
        Property Node(instance in=w15) -> ("Program Log Text"=w63, instance out=w64)
        Variant To Data(error in (no error)=w20, type=string "", variant=w19) -> (data=w65, error out=w21)
        Format Into String(formatString="%s\n%s", w63, w65) -> w66
        Property Node(instance in=w64, "Program Log Text"=w66) -> (instance out=w23)
        $"Program Log" <- w66
        w22 = default
      }
      frame "Update Program Status" {
        Variant To Data(error in (no error)=w20, type=w18, variant=w19) -> (data=w67, error out=w21)
        $"Program Status" <- w67
        w22 = default
        w23 = w15
      }
      frame "Initialize Complete" {
        $Initialized <- TRUE
        w21 = w20
        w22 = default
        w23 = w15
      }
      frame "Initialize" {
        Property Node(instance in=w15) -> ("Test Steps"=w68, instance out=w69)
        Max And Min(x=w68, y=1) -> (max(x,y)=w70: i32)
        Initialize Array(element="Step Status.gtype" {all zero or empty}, size=w70) -> w71
        Property Node(instance in=w69, "Step Index"=0, "Test Data"=f64[][] [], "Steps Statuses"=w71) -> (instance out=w23)
        # Enure at least 1 step is present
        Property Node(instance in=reference to "Initialized", "Value"=FALSE, error in=w20) -> (error out=w72, instance out=w73)
        Property Node(instance in=reference to "Result", "Value"=FALSE, error in=w20) -> (error out=w74, instance out=w75)
        # Prevent user from changing test
        Property Node(instance in=reference to "Test Steps", "Disabled"=TRUE, error in=w20) -> (error out=w76, instance out=w77)
        Property Node(instance in=reference to "Finalized", "Value"=FALSE, error in=w20) -> (error out=w78, instance out=w79)
        call "Prep Step Staus for Display.gviweb"(Steps Status=w71) -> (Step Status for Display=w80)
        Property Node(instance in=reference to "Step Status", "Value"=w80, error in=w20) -> (error out=w81, instance out=w82)
        Merge Errors(w81, w72, w78, w74, w76) -> (error out=w83)
        Build Array(w82, w73, w79, w75, w77) -> w84
        for {
          w85 = each element of w84
          Close Reference(reference=w85) -> (error out=w87)
          append w87 to w86
        }
        Merge Errors(w86, w83) -> (error out=w88)
        call "Report Step Complete.gviweb"(Manager Queue=w11, This Queue Name="UI", Step Name=w18, Error in=w88) -> (Error out=w21)
        w22 = default
      }
      frame "Execute Complete" {
        # It's likely that data is remaining in queue
        call "Handle Data Remaining in Queue.gviweb"(UI Data in=w15, Step Status reference=reference to "Step Status", Graph reference=reference to "Graph", error in=w20, Test Data queue=w6) -> (UI Data out=w23, error out=w21)
        w22 = default
      }
      frame "Finalize" {
        Property Node(instance in=w15) -> ("Steps Statuses"=w89, instance out=w90)
        # stop polling
        Property Node(instance in=w90, "Dequeue Timeout"=-1) -> (instance out=w23)
        # Lights up LED
        $Result <- TRUE
        # Allow user to interact with test sequence again
        Property Node(instance in=reference to "Test Steps", "Disabled"=TRUE, error in=w20) -> (error out=w91, instance out=w92)
        Close Reference(error in=w91, reference=w92) -> (error out=w93)
        # If pass, allow fail or cancel to overrided.
        # If fail, allow cancel to override.
        # If cancel, nothing overrides.
        s2 = "Pass"  # shift register
        for {
          w94 = each element of w89
          Property Node(instance in=w94) -> ("Result"=w95)
          case (s2) {
            frame "Pass", Default {
              w96 = w95
            }
            frame "Fail" {
              case (w95) {
                frame Default {
                  w96 = w95
                }
                frame "Pass" {
                  w96 = s2
                }
              }
            }
            frame "Canceled" {
              w97 = "Canceled"  # Step Result
              w96 = w97
            }
          }
          next s2 = w96
        }
        call "Get Result Color.gviweb"(Input=s2) -> (Output=w98)
        # Get color and text of big result LED by checking status of all tests
        Format Into String(formatString="%s", s2) -> w99
        Build Array(w99) -> w100
        Property Node(instance in=reference to "Result", "TrueColor"=w98, "Text"=w100, error in=w20) -> (error out=w101, instance out=w102)
        Close Reference(error in=w101, reference=w102) -> (error out=w103)
        Merge Errors(w103, w93) -> (error out=w104)
        call "Report Step Complete.gviweb"(Manager Queue=w11, This Queue Name="UI", Step Name=w18, Error in=w104) -> (Error out=w21)
        w22 = default
      }
      frame "Finalize Complete" {
        $Finalized <- TRUE
        Property Node(instance in=reference to "Test Steps", "Disabled"=FALSE, error in=w20) -> (error out=w105, instance out=w106)
        Close Reference(error in=w105, reference=w106) -> (error out=w21)
        w22 = default
        w23 = w15
      }
      frame "Cancel" {
        Property Node(instance in=w15) -> ("Steps Statuses"=w107, "Step Index"=w108, instance out=w109)
        Array Index(array=w107) -> (out0[w108]=w110)
        # Mark current step as canceled. This must occur before data processing for proper execution of processing function.
        Property Node(instance in=w110, "Result"="Canceled") -> (instance out=w111)
        Replace Array Subset(inArray=w107, index=w108, new=w111) -> w112
        Property Node(instance in=w109, "Steps Statuses"=w112) -> (instance out=w113)
        call "Handle Data Remaining in Queue.gviweb"(UI Data in=w113, Step Status reference=reference to "Step Status", Graph reference=reference to "Graph", error in=w20, Test Data queue=w6) -> (UI Data out=w23, error out=w114)
        call "Report Step Complete.gviweb"(Manager Queue=w11, This Queue Name="UI", Step Name=w18, Error in=w114) -> (Error out=w21)
        w22 = default
      }
      frame "Cancel Complete" {
        w21 = w20
        w22 = default
        w23 = w15
      }
      frame "Exit" {
        Release Queue(queue=w17) -> (error out=w115)
        Release Queue(queue=w6) -> (error out=w116)
        Merge Errors(w20, w115, w116) -> (error out=w21)
        w22 = TRUE
        w23 = w15
      }
      frame Default {
        case (w16) {
          frame True {
            call "Receive IO Data.gviweb"(UI Data in=w15, error in=w20, IO Data Queue=w6) -> (UI Data out=w117, error out=w21, Test Data for Graph=w118)
            # New data from IO available
            $Graph <- w118
            Property Node(instance in=w117) -> ("Steps Statuses"=w119, instance out=w23)
            # Poll at designated rate to avoid consuming processor resources
            call "Prep Step Staus for Display.gviweb"(Steps Status=w119) -> (Step Status for Display=w120)
            $"Step Status" <- w120
            call "globals.gviweb"() -> (Globals=w121)
            Property Node(instance in=w121) -> ("UI Polling Period (ms)"=w122)
            Wait(time to wait=w122)
          }
          frame False {
            call "Generate Undefined Message Error.gviweb"(Queue Name="UI", Message=w18, Error in=w20) -> (Error out=w21)
            w23 = w15
          }
        }
        w22 = default
      }
    }
    call "Handle Error.gviweb"(Input=w11, Input_2="UI", Output_2=w21) -> (Output_3=w123)
    next s1 = w23
    stop if w22
  }
  call "globals.gviweb"() -> (Globals=w124)
  Property Node(instance in=w124) -> ("IO Loop Period (ms)"=w125)
  Array Index(array=w9) -> (out0["Manager"]=w126, out1["IO"]=w127)
  s3 = uninitialised  # shift register
  s4 = uninitialised  # shift register
  while {
    # w126: Manager
    call "Dequeue Message.gvi"(message queue in=w127, timeout in milliseconds=0, error in=w10) -> (timed out?=w128, message queue out=w129, message=w130, message data=w131, error out=w132)
    # UI Update Loop
    # "IO": IO Name
    # s3: Test Sequence
    # s4: IO Data
    # w6: Test Data
    case (w130) ignore case {  # Message Cases
      frame "SW Init" {
        w133 = w132
        w134 = default
        w135 = s3
        w136 = "IO Data.gtype" {all zero or empty}
      }
      frame "Initialize" {
        disable {
          frame Disabled {
            # #Integrate_Hardware
            # Hardware uninitialization goes here
            w137 = w132
          }
          frame Enabled {
            call "globals.gviweb"() -> (Globals=w138)
            Property Node(instance in=w138) -> ("Hardware Initialize Duration (s)"=w139)
            # #Integrate_Hardware
            Multiply(w139, 1000) -> w140
            Wait(time to wait=w140)
            w137 = w132
          }
        }
        call "Prep Next Waveform.gviweb"(Test Sequence in=$"Test Steps", IO Data In=s4) -> (Test Sequence out=w135, IO Data out=w136)
        sequence {
          frame 0 {
            call "Report Step Complete.gviweb"(Manager Queue=w126, This Queue Name="IO", Step Name=w130, Error in=w137) -> (Error out=w133)
          }
        }
        w134 = default
      }
      frame "Finalize" {
        disable {
          frame Disabled {
            # #Integrate_Hardware
            # Hardware uninitialization goes here
            w141 = w132
          }
          frame Enabled {
            call "globals.gviweb"() -> (Globals=w142)
            Property Node(instance in=w142) -> ("Hardware Finalize Duration (s)"=w143)
            # #Integrate_Hardware
            Multiply(w143, 1000) -> w144
            Wait(time to wait=w144)
            w141 = w132
          }
        }
        call "Report Step Complete.gviweb"(Manager Queue=w126, This Queue Name="IO", Step Name=w130, Error in=w141) -> (Error out=w133)
        w134 = default
        w135 = s3
        w136 = s4
      }
      frame "Execute" {
        # Start hardware IO
        Property Node(instance in=s4, "Wave Active"=TRUE) -> (instance out=w136)
        w133 = w132
        w134 = default
        w135 = s3
      }
      frame "Cancel" {
        sequence {
          frame 0 {
            # Stop hardware IO
            Property Node(instance in=s4, "Wave Active"=FALSE) -> (instance out=w136)
          }
        }
        call "Report Step Complete.gviweb"(Manager Queue=w126, This Queue Name="IO", Step Name=w130, Error in=w132) -> (Error out=w133)
        w134 = default
        w135 = s3
      }
      frame "Exit" {
        Release Queue(queue=w129) -> (error out=w145)
        Merge Errors(w132, w145) -> (error out=w133)
        w134 = TRUE
        w135 = s3
        w136 = s4
      }
      frame Default {
        case (w128) {
          frame True {
            Property Node(instance in=s4) -> ("Wave Active"=w146, instance out=w147)
            # No message -> handle hardware IO
            case (w146) {
              frame False, Default {
                # Wave inactive -> no IO
                w136 = w147
                w133 = w132
                w135 = s3
              }
              frame True {
                Property Node(instance in=w147) -> ("New Wave"=w148, instance out=w149)
                case (w148) {
                  frame False, Default {
                    w150 = w149
                  }
                  frame True {
                    Get Current Time() -> (current time=w151)
                    # only save init timestamp at wave start
                    Property Node(instance in=w149, "Start Time"=w151, "New Wave"=FALSE) -> (instance out=w150)
                  }
                }
                call "Generate Waveform.gviweb"(IO Data=w150) -> (Time Elapsed=w152, IO data out=w153, Wave Value=w154, Fraction Complete=w155)
                call "Handle Hardware IO.gviweb"(IO data in=w153, Hardware output=w154, Time Elapsed=w152) -> (IO data out=w156, Hardware input=w157)
                call "Check Test Sequence Complete.gviweb"(This Queue Name="IO", Test Sequence in=s3, IO data in=w156, Fraction Complete=w155, Manager Queue=w126) -> (Test Sequence out=w135, IO data out=w136, Fraction Complete (includes messages)=w158)
                call "Calculate Target Value.gviweb"(Wave Value=w154) -> (Target=w159)
                Build Array(w158, w159, w157) -> w160
                Enqueue Element(element=w160, error in=w132, queue=w6) -> (error out=w133)
              }
            }
          }
          frame False {
            # Received message
            call "Generate Undefined Message Error.gviweb"(Queue Name="IO", Message=w130, Error in=w132) -> (Error out=w133)
            w136 = s4
            w135 = s3
          }
        }
        w134 = default
      }
    }
    call "Handle Error.gviweb"(Input=w126, Input_2="IO", Output_2=w133) -> (Output_3=w161)
    Wait(time to wait=w125)
    next s3 = w135
    next s4 = w136
    stop if w134
  }
  Array Index(array=w9) -> (out0["Manager"]=w162)
  call "Define Program Instructions.gviweb"() -> (Instructions=w163, Instruction names=w164)
  s5 = uninitialised  # shift register
  while {
    # w9: Message Queues
    call "Dequeue Message.gvi"(message queue in=w162, error in=w10) -> (message queue out=w165, message=w166, message data=w167, error out=w168)
    # "Manager": Manager Queue Name
    # w4: Stop Event
    # s5: Manager Data
    # w163: Instructions
    # w164: Instruction Names
    case (w166) ignore case {  # Message Cases
      frame "SW Init" {
        w169 = w168
        w170 = default
        w171 = "Manager Data.gtype" {all zero or empty}
      }
      frame "Test Sequence Change" {
        Array Index(array=w9) -> (out0["UI"]=w172)
        call "Enqueue Message (Single).gvi"(message queue in=w172, message="Handle Test Change", message data=w167, error in=w168) -> (error out=w169)
        w170 = default
        w171 = s5
      }
      frame "Error" {
        Variant To Data(error in (no error)=w168, type="Error Data.gtype" {all zero or empty}, variant=w167) -> (data=w173, error out=w174)
        Property Node(instance in=w173) -> ("Error Origin"=w175, "Error In"=w176)
        Property Node(instance in=w176) -> ("code"=w177, "source"=w178)
        w179 = "================\nError\n\nAt: %s\n\nCode: %d\n%s\n================"
        Format Into String(formatString=w179, errIn=w174, w175, w177, w178) -> (outString=w180, errOut=w181)
        call "Append Log Text.gviweb"(Message Queues in=w9, Update Tex=w180, Error in=w181) -> (Error out_2=w169)
        w170 = default
        w171 = s5
      }
      frame "Exit Pressed" {
        # #development
        s6 = w168  # shift register
        for {
          w182 = each element of w9
          call "Enqueue Message (Single).gvi"(message queue in=w182, message="Exit", error in=s6) -> (error out=w183)
          next s6 = w183
        }
        w169 = s6
        w170 = default
        w171 = s5
      }
      frame "Exit" {
        Generate User Event(event data=TRUE, user event=w4) -> (error out=w184)
        Release Queue(queue=w165) -> (error out=w185)
        Merge Errors(w185, w184) -> (error out=w169)
        w170 = TRUE
        w171 = s5
      }
      frame Default {
        call "Generate Undefined Message Error.gviweb"(Queue Name="Manager", Message=w166, Error in=w168) -> (Error out=w169)
        w170 = default
        w171 = s5
      }
      frame "Instruction" {
        # w186: Instruction Name
        Variant To Data(error in (no error)=w168, type=w166, variant=w167) -> (data=w186, error out=w187)
        Search 1D Array(1D array=w164, element=w186) -> (index of element=w188)
        case (w188) {
          frame Default {
            Array Index(array=w163) -> (out0[w188]=w189)
            Property Node(instance in=w189) -> ("Init Info:Valid Starts"=w190, instance out=w191)
            Property Node(instance in=s5) -> ("Current State"=w192, instance out=w193)
            Search 1D Array(1D array=w190, element=w192) -> (index of element=w194)
            # Message in sequence start list -> ensure in valid start state
            case (w194) {
              frame Default {
                # In valid state for recieved message -> react
                Property Node(instance in=w191) -> ("Sequences"=w195)
                Format Into String(formatString="******************\nStart: %s\n******************", errIn=w187, w186) -> (outString=w196, errOut=w197)
                call "Append Log Text.gviweb"(Message Queues in=w9, Update Tex=w196, Error in=w197) -> (Message Queues out=w198, Error out_2=w199)
                call "Handle Next Sequence.gviweb"(Manager data in=w193, Sequences=w195, error in=w199, Message Queues=w198) -> (manager data out=w200, Sequence Steps=w201, End Instruction=w202, error out=w203, Message Queues out=w204)
                case (w202) {
                  frame True {
                    # #verify - new instruction, but sequences empty
                    w205 = "-------------------------------------\nInstruction Sequences Empty\n-------------------------------------"
                    call "Append Log Text.gviweb"(Message Queues in=w204, Update Tex=w205, Error in=w203) -> (Error out_2=w169)
                    w171 = w200
                  }
                  frame False {
                    Property Node(instance in=w200, "Current Instruction"=w186) -> (instance out=w206)
                    # Start first step in first sequence
                    call "Handle Next Step.gviweb"(Manager Data in=w206, Sequence Steps=w201, Error in=w203, Nessage Queues in=w204) -> (Manager Data out=w171, Error out=w169)
                  }
                }
              }
              frame -1 {
                w207 = """-------------------------------------
Received inavalid message for current status

Invalid Message: %s

State: %s
Currently waiting on: %s
-------------------------------------"""
                Property Node(instance in=w193) -> ("Current State"=w208, "Current Step:Message Queue"=w209)
                Format Into String(formatString=w207, errIn=w187, w186, w208, w209) -> (outString=w210, errOut=w211)
                call "Append Log Text.gviweb"(Message Queues in=w9, Update Tex=w210, Error in=w211) -> (Error out_2=w169)
                w171 = w193
              }
            }
          }
          frame -1 {
            # Instruction name missing from list -> undefined
            Format Into String(formatString="Instruction \"%s\" undefined.", w186) -> w212
            call "Build Error Cluster.gvi"(code=1, description=w212, error in=w187) -> (error out=w169)
            w171 = s5
          }
        }
        w170 = default
      }
      frame "Step Complete" {
        Property Node(instance in=s5) -> ("Current Step"=w213)
        Variant To Data(error in (no error)=w168, type=w213, variant=w167) -> (data=w214, error out=w215)
        Is Equal[ComparisonMode=CompareAggregates](x=w213, y=w214) -> w216
        case (w216) {
          frame False, Default {
            w217 = "Unexpected \"Step Complete\" message \n\nFrom: %s with action %s\nExpected: %s with action %s"
            Property Node(instance in=w214) -> ("Message Queue"=w218, "Action"=w219)
            Property Node(instance in=w213) -> ("Message Queue"=w220, "Action"=w221)
            Format Into String(formatString=w217, w218, w219, w220, w221) -> w222
            call "Append Log Text.gviweb"(Message Queues in=w9, Update Tex=w222, Error in=w215) -> (Error out_2=w169)
            w171 = s5
          }
          frame True {
            # Expected complete message received
            Property Node(instance in=s5) -> ("Remaining Steps"=w223, instance out=w224)
            Array Size(array=w223) -> (size(s)=w225)
            Property Node(instance in=w213) -> ("Message Queue"=w226, "Action"=w227)
            Format Into String(formatString="Completed %s %s", errIn=w215, w226, w227) -> (outString=w228, errOut=w229)
            call "Append Log Text.gviweb"(Message Queues in=w9, Update Tex=w228, Error in=w229) -> (Message Queues out=w230, Error out_2=w231)
            case (w225) {
              frame Default {
                # Steps remaining -> handle next step
                call "Handle Next Step.gviweb"(Manager Data in=w224, Sequence Steps=w223, Error in=w231, Nessage Queues in=w230) -> (Manager Data out=w171, Error out=w169)
              }
              frame 0 {
                Property Node(instance in=w224) -> ("Remaining Sequences"=w232, "Current State"=w233, instance out=w234)
                call "Send Sequence Complete UI Updates.gviweb"(Message queues in=w230, Current State=w233, Error In=w231) -> (Message queues out=w235, Error out=w236)
                call "Handle Next Sequence.gviweb"(Manager data in=w234, Sequences=w232, error in=w236, Message Queues=w235) -> (manager data out=w237, Sequence Steps=w238, End Instruction=w239, error out=w240, Message Queues out=w241)
                Property Node(instance in=w237) -> ("Current State"=w242, instance out=w243)
                # Sequence complete -> handle next sequence if it exists
                Format Into String(formatString="%s", errIn=w240, w242) -> (outString=w244, errOut=w245)
                call "Update Program Status.gviweb"(Message Queues in=w241, Status=w244, Error in=w245) -> (Message Queues out=w246, Error out=w247)
                case (w239) {
                  frame False, Default {
                    # Handle next step of next sequence
                    call "Handle Next Step.gviweb"(Manager Data in=w243, Sequence Steps=w238, Error in=w247, Nessage Queues in=w246) -> (Manager Data out=w171, Error out=w169)
                  }
                  frame True {
                    Property Node(instance in=w243) -> ("Current Instruction"=w248, instance out=w249)
                    # No more sequences -> Instruction complete
                    # prevents confusion of manager possibly waiting on another loop
                    Property Node(instance in=w249, "Current Step:Message Queue"="Manager") -> (instance out=w171)
                    Format Into String(formatString="******************\nComplete: %s\n******************", errIn=w247, w248) -> (outString=w250, errOut=w251)
                    call "Append Log Text.gviweb"(Message Queues in=w246, Update Tex=w250, Error in=w251) -> (Error out_2=w169)
                  }
                }
              }
            }
          }
        }
        w170 = default
      }
    }
    call "Handle Error.gviweb"(Input=w165, Input_2="Manager", Output_2=w169) -> (Output_3=w252)
    next s5 = w171
    stop if w170
  }
  # #todo
  # save all text log messages in same place
  # change status text so instruction, sequence and steps are clearly identifiable
  # 	sequence not to be confused with test sequence (maybe change one to routine?) -> attempted this and caused VI to become corrupt
  # create/ configure simulation cases/ flags
  Register For Events("Stop Event"=w4) -> (event registration refnum out=w253)
  # #feature_list
  # Hardware fault
  # 	be able to clear error with corresponding case in IO
  # 	handle during initialize or execute
  # Abort
  # Pause
  # Pass initial instruction data to individual steps
  # Display test history/ data
  # Select between historical test data for display
  # 	Historical analysis/ comparison
  # Splining/ smooth transitions between waveforms
  # 	Force sawtooth to return to 0 before waveform transition?
  # Unit tests
  # Check for empty test sequence
  Array Index(array=w9) -> (out0["Manager"]=w254)
  # The framework behind this sequencer operates by handling instructions in a manager loop. Instructions are initiated by sending an "Instruction" message via the manager's queue (marked with ******************) and checked against a list of valid start states.  In each sequence element in the instruction, a manager state name is defined ("____ Start") and the program status is updated upon reaching that element. The sequence steps are then executed sequentially by sending a message to the corresponding loop ("Waiting on ___ to ___..."), with the manager then expecting a response to indicate each step's completion via the Report Step Complete VI ("Completed ___ ___").  This framework allows for easily reconfigurable program execution with the order of execution being defined as structured overview in a single location. Adding additional step types requires simply adding a corresponding step to a desired loop.
  #
  # Note:
  # - The array nested in program sequences contains the individual steps to be executed, each in turn containing a message queue/ loop name and a message defining the action to be completed.
  # - The final emtpy sequence in the array is used to set the final state of the manager.
  # - The UI loop receives a "___ Complete" upon the conclusion of all steps in any given sequence, with the ___ being the state name.
  # - The names of the step messages do not have to match the name of the manager state for that sequence.
  # - Instructions cannot be queued. There can only be one active at a time.
  # - Instruction names, start states and corresponding sequences are defined and stored in the Define Program Instructions VI, being made available to the manager at program start.
  # Run Test Sequence example
  #
  # State: Idle
  #
  # Start Pressed
  #
  # Initialize
  # 	>> To UI ---Initialize
  # 	Waiting on UI
  # 	>> To IO ---Initialize
  # 	Waiting on IO
  # Execute
  # 	>> To UI ---Execute
  # 	Waiting on UI
  # 	>> To IO ---Execute
  # 	Waiting on IO
  # Finalize
  # 	>> To IO ---Finalize
  # 	Waiting on IO
  # 	>> To UI ---Finalize
  # 	Waiting on UI
  # Idle
  s7 = w253  # shift register
  while {
    event (dynamic events = s7) {
      on "Test Start" Value changed {
        call "Enqueue Message (Single).gvi"(message queue in=w254, message="Instruction", message data="Run Test Sequence") -> (message queue out=w257, error out=w256)
        w255 = default
      }
      on "Cancel" Value changed {
        call "Enqueue Message (Single).gvi"(message queue in=w254, message="Instruction", message data="Cancel") -> (message queue out=w257, error out=w256)
        w255 = default
      }
      on "Exit (development only)" Value changed {
        call "Enqueue Message (Single).gvi"(priority message=TRUE, message queue in=w254, message="Exit Pressed") -> (message queue out=w257, error out=w256)
        w255 = default
      }
      on dynamic event 0 {
        # The Message Handling Loop processed an "Exit" message, which fired this event to stop the Event Handling Loop.
        w255 = TRUE
        w256 = default
        w257 = w254
      }
      on "Test Steps" Value changed {
        Event Data() -> ("New Value"=w258)
        To Variant(anything=w258) -> w259
        call "Enqueue Message (Single).gvi"(message queue in=w254, message="Test Sequence Change", message data=w259) -> (message queue out=w257, error out=w256)
        w255 = default
      }
    }
    call "Error Handler - Event Handling Loop.gvi"(message queue in=w257, error in=w256) -> (dup error in=w260)
    stop if w255
  }
  Unregister For Events(error in=w260, event registration refnum=s7) -> (error out=w261)
  Merge Errors(w261, w252, w123, w161) -> (error out=w262)
  Destroy User Event(error in=w262, user event=w4)
