vi "Handle Next Sequence.gviweb"   [G Web Development Software 22.3.0]
inputs:
  "Manager data in": "Manager Data.gtype", required
  "Sequences": T2[], required
  "Message Queues": Queue<"Message Cluster.gtype">[], required
  "error in": error
outputs:
  "manager data out": "Manager Data.gtype"
  "Sequence Steps": T1[]
  "End Instruction": bool
  "error out": error
  "Message Queues out": Queue<"Message Cluster.gtype">[]
types:
  "Manager State.gtype" = enum{"Idle", "Initialize", "Execute", "Finalize", "Cancel", "Error"}
  "Message Queue Names.gtype" = enum{"Manager", "UI", "IO"}
  "Step Data.gtype" = cluster{"Message Queue": "Message Queue Names.gtype", "Action": string}
  "Sequence.gtype" = cluster{"Manager State": "Manager State.gtype", "Steps": "Step Data.gtype"[]}
  "Manager Data.gtype" = cluster{"Current State": "Manager State.gtype", "Current Step": "Step Data.gtype", "Remaining Steps": "Step Data.gtype"[], "Remaining Sequences": "Sequence.gtype"[], "Current Instruction": string}
  T1 = cluster{"Message Queue": "Message Queue Names.gtype", "Action": string}
  T2 = cluster{"State": "Manager State.gtype", "Steps": T1[]}
  "Message Cluster.gtype" = cluster{"Message": string, "Message Data": variant}
uses:
  WebApp::UI::Messages::Append Log Text.gviweb
  WebApp::UI::Messages::Update Program Status.gviweb
diagram:
  Array Size(array=$Sequences) -> (size(s)=w1)
  case (w1) {
    frame 0 {
      # Sequences empty -> Instruction complete
      Property Node(instance in=$"Manager data in", "Current State"="Idle") -> (instance out=w2)
      w3 = default
      w4 = TRUE
      w5 = $"error in"
      w6 = $"Message Queues"
    }
    frame Default {
      # Get next sequence
      Delete From Array(inArray=$Sequences, index0=0) -> (outArray=w7, deleted=w8)
      Property Node(instance in=w8) -> ("State"=w9, "Steps"=w3)
      Array Size(array=w3) -> (size(s)=w10)
      # Sequences present
      case (w10) {
        frame 0 {
          # Sequence devoid of steps -> End instruction and set state as current
          Property Node(instance in=$"Manager data in", "Current State"=w9) -> (instance out=w2)
          w4 = TRUE
          w5 = $"error in"
          w6 = $"Message Queues"
        }
        frame Default {
          # Sequence steps present -> sequence is valid, so save new state
          Property Node(instance in=$"Manager data in", "Current State"=w9, "Remaining Sequences"=w7) -> (instance out=w2)
          Format Into String(formatString="%s Start", errIn=$"error in", w9) -> (outString=w11, errOut=w12)
          call "Append Log Text.gviweb"(Message Queues in=$"Message Queues", Update Tex=w11, Error in=w12) -> (Message Queues out=w6, Error out_2=w5)
          w4 = FALSE
        }
      }
    }
  }
  Property Node(instance in=w2) -> ("Current State"=w13, instance out=w14)
  Format Into String(formatString="%s", w13) -> w15
  call "Update Program Status.gviweb"(Message Queues in=w6, Status=w15, Error in=w5) -> (Message Queues out=w16, Error out=w17)
  $"Message Queues out" <- w16
  $"manager data out" <- w14
  $"Sequence Steps" <- w3
  $"End Instruction" <- w4
  $"error out" <- w17
