vi "Handle Next Step.gviweb"   [G Web Development Software 22.3.0]
inputs:
  "Nessage Queues in": Queue<"Message Cluster.gtype">[], required
  "Manager Data in": "Manager Data.gtype", required
  "Sequence Steps": T1[], required
  "Error in": error
outputs:
  "Manager Data out": "Manager Data.gtype"
  "Error out": error
panel controls:
  "message data": variant
panel indicators:
  "Message Queues out": Queue<"Message Cluster.gtype">[]
types:
  "Manager State.gtype" = enum{"Idle", "Initialize", "Execute", "Finalize", "Cancel", "Error"}
  "Message Queue Names.gtype" = enum{"Manager", "UI", "IO"}
  "Step Data.gtype" = cluster{"Message Queue": "Message Queue Names.gtype", "Action": string}
  "Sequence.gtype" = cluster{"Manager State": "Manager State.gtype", "Steps": "Step Data.gtype"[]}
  "Manager Data.gtype" = cluster{"Current State": "Manager State.gtype", "Current Step": "Step Data.gtype", "Remaining Steps": "Step Data.gtype"[], "Remaining Sequences": "Sequence.gtype"[], "Current Instruction": string}
  T1 = cluster{"Message Queue": "Message Queue Names.gtype", "Action": string}
  "Message Cluster.gtype" = cluster{"Message": string, "Message Data": variant}
uses:
  WebApp::UI::Messages::Append Log Text.gviweb
  WebApp::support::Message Queue::Enqueue Message (Single).gvi
diagram:
  Delete From Array(inArray=$"Sequence Steps", index0=0) -> (outArray=w1, deleted=w2)
  Property Node(instance in=$"Manager Data in", "Current Step"=w2, "Remaining Steps"=w1) -> (instance out=w3)
  $"Manager Data out" <- w3
  $"Message Queues out" <- $"Nessage Queues in"
  # Update current step and save remaining for future
  Property Node(instance in=w2) -> ("Message Queue"=w4, "Action"=w5)
  Array Index(array=$"Nessage Queues in") -> (out0[w4]=w6)
  Format Into String(formatString="Waiting on %s to %s...", w4, w5) -> w7
  call "Append Log Text.gviweb"(Message Queues in=$"Nessage Queues in", Update Tex=w7, Error in=$"Error in") -> (Error out_2=w8)
  call "Enqueue Message (Single).gvi"(message queue in=w6, message=w5, message data=$"message data", error in=w8) -> (error out=w9)
  $"Error out" <- w9
