vi "Report Step Complete.gviweb"   [G Web Development Software 22.3.0]
inputs:
  "Manager Queue": Queue<"Message Cluster.gtype">, required
  "This Queue Name": "Message Queue Names.gtype" = "Manager", required
  "Step Name": string, required
  "Error in": error
outputs:
  "Error out": error
types:
  "Message Queue Names.gtype" = enum{"Manager", "UI", "IO"}
  "Message Cluster.gtype" = cluster{"Message": string, "Message Data": variant}
  "Step Data.gtype" = cluster{"Message Queue": "Message Queue Names.gtype", "Action": string}
uses:
  WebApp::support::Message Queue::Enqueue Message (Single).gvi
diagram:
  Property Node(instance in="Step Data.gtype" {all zero or empty}, "Message Queue"=$"This Queue Name", "Action"=$"Step Name") -> (instance out=w1)
  call "Enqueue Message (Single).gvi"(message queue in=$"Manager Queue", message="Step Complete", message data=w1, error in=$"Error in") -> (error out=w2)
  $"Error out" <- w2
