vi "Handle Next Sequence.gviweb"   [G Web Development Software 22.3.0]
inputs:
  "manager data in": "Manager Data.gtype", required
  "Sequences": T2[], required
  "Message Queues": Queue<"Message Cluster.gtype">[], required
  "error in": error
outputs:
  "manager data out": "Manager Data.gtype"
  "Sequence Steps": T1[]
  "End Instruction": bool
  "error out": error
types:
  "Manager State.gtype" = enum{"Idle", "Initialize", "Execute", "Finalize", "Complete", "Error"}
  "Message Queue Names.gtype" = enum{"Manager", "UI", "IO"}
  "Step Data.gtype" = cluster{"Message Queue": "Message Queue Names.gtype", "Action": string}
  "Sequence.gtype" = cluster{"Manager State": "Manager State.gtype", "Steps": "Step Data.gtype"[]}
  "Manager Data.gtype" = cluster{"Current State": "Manager State.gtype", "Current Step": "Step Data.gtype", "Remaining Steps": "Step Data.gtype"[], "Remaining Sequences": "Sequence.gtype"[], "Current Instruction": string}
  T1 = cluster{"Message Queue": "Message Queue Names.gtype", "Action": string}
  T2 = cluster{"State": "Manager State.gtype", "Steps": T1[]}
  "Message Cluster.gtype" = cluster{"Message": string, "Message Data": variant}
uses:
  WebApp::UI messages::Append Log Text.gviweb
  WebApp::UI messages::Update Program Status.gviweb
diagram:
  Array Size(array=$Sequences) -> (size(s)=w1)
  case (w1) {
    frame 0 {
      # Sequences empty
      Property Node(instance in=$"manager data in", "Current State"="Idle") -> (instance out=w2)
      w3 = default
      w4 = TRUE
      w5 = $"error in"
    }
    frame Default {
      Delete From Array(inArray=$Sequences, index0=0) -> (outArray=w6, deleted=w7)
      Property Node(instance in=w7) -> ("State"=w8, "Steps"=w3)
      Array Size(array=w3) -> (size(s)=w9)
      case (w9) {
        frame 0 {
          # Sequence devoid of steps -> End instruction and set state as current
          Property Node(instance in=$"manager data in", "Current State"=w8) -> (instance out=w2)
          w4 = TRUE
          w5 = $"error in"
        }
        frame Default {
          Property Node(instance in=$"manager data in", "Current State"=w8, "Remaining Sequences"=w6) -> (instance out=w2)
          Format Into String(formatString="%s Start", errIn=$"error in", w8) -> (outString=w10, errOut=w11)
          call "Append Log Text.gviweb"(Input=$"Message Queues", resulting string=w10, error out=w11) -> (Output_2=w5)
          w4 = FALSE
        }
      }
    }
  }
  Property Node(instance in=w2) -> ("Current State"=w12, instance out=w13)
  $"manager data out" <- w13
  $"Sequence Steps" <- w3
  $"End Instruction" <- w4
  Format Into String(formatString="%s", w12) -> w14
  call "Update Program Status.gviweb"(resulting string=w14, Message Queues=$"Message Queues", Input=w5) -> (error out=w15)
  $"error out" <- w15
