vi "Handle Next Step.gviweb"   [G Web Development Software 22.3.0]
inputs:
  "message queues": Queue<"Message Cluster.gtype">[], required
  "manager data in": "Manager Data.gtype", required
  "Sequence Steps": T1[], required
  "Input": error
  "message data": variant
outputs:
  "manager data out": "Manager Data.gtype"
  "Output": error
types:
  "Manager State.gtype" = enum{"Idle", "Initialize", "Execute", "Finalize", "Error"}
  "Message Queue Names.gtype" = enum{"Manager", "UI", "IO"}
  "Step Data.gtype" = cluster{"Message Queue": "Message Queue Names.gtype", "Action": string}
  "Sequence.gtype" = cluster{"Manager State": "Manager State.gtype", "Steps": "Step Data.gtype"[]}
  "Manager Data.gtype" = cluster{"Current State": "Manager State.gtype", "Current Step": "Step Data.gtype", "Remaining Steps": "Step Data.gtype"[], "Remaining Sequences": "Sequence.gtype"[]}
  T1 = cluster{"Message Queue": "Message Queue Names.gtype", "Action": string}
  "Message Cluster.gtype" = cluster{"Message": string, "Message Data": variant}
uses:
  WebApp::UI messages::Append Log Text.gviweb
  WebApp::support::Message Queue::Enqueue Message (Single).gvi
diagram:
  Delete From Array(inArray=$"Sequence Steps", index0=0) -> (outArray=w1, deleted=w2)
  Property Node(instance in=$"manager data in", "Current Step"=w2, "Remaining Steps"=w1) -> (instance out=w3)
  $"manager data out" <- w3
  Property Node(instance in=w2) -> ("Message Queue"=w4, "Action"=w5)
  Array Index(array=$"message queues") -> (out0[w4]=w6)
  Format Into String(formatString="Waiting on %s to %s...", w4, w5) -> w7
  call "Append Log Text.gviweb"(Input=$"message queues", resulting string=w7, error out=$Input) -> (Output_2=w8)
  call "Enqueue Message (Single).gvi"(message queue in=w6, message=w5, message data=$"message data", error in=w8) -> (error out=w9)
  $Output <- w9
