vi "Create All Message Queues.gvi"   [G Web Development Software 22.3.0]
# This VI creates and initializes all the message queues for your application. If your application requires more than one message queue, right-click the "Message Queues" constant above and select Open Type Def.  Add the new Message Queue(s) to the type definition, then initialize them in this VI.
inputs:
  "Loop Count": i32 = 1
  "error in": error
outputs:
  "Message Queues": Queue<"Message Cluster.gtype">[]
  "error out": error
types:
  "Message Cluster.gtype" = cluster{"Message": string, "Message Data": variant}
uses:
  WebApp::support::Message Queue::Obtain Message Queue.gvi
  WebApp::support::Message Queue::Enqueue Message (Single).gvi
diagram:
  # This VI creates and initializes all the message queues for your application. If your application requires more than one message queue, right-click the "Message Queues" constant above and select Open Type Def.  Add the new Message Queue(s) to the type definition, then initialize them in this VI.
  case ($"error in") {
    frame No Error {
      s1 = $"error in"  # shift register
      for (N = $"Loop Count") {
        call "Obtain Message Queue.gvi"(error in=s1) -> (message queue=w3, error out=w4)
        call "Enqueue Message (Single).gvi"(message queue in=w3, message="SW Init", error in=w4) -> (error out=w5)
        append w3 to w2
        next s1 = w5
      }
      w1 = s1
    }
    frame Error {
      w1 = $"error in"
      w2 = default
    }
  }
  $"Message Queues" <- w2
  $"error out" <- w1
