vi "Dequeue Message.gvi"   [G Web Development Software 22.3.0]
# This VI pulls messages off the Message Queue.
inputs:
  "message queue in": Queue<"Message Cluster.gtype">, required
  "timeout in milliseconds": i32 = -1
  "error in": error
outputs:
  "message queue out": Queue<"Message Cluster.gtype">
  "timed out?": bool
  "message": string
  "message data": variant
  "error out": error
types:
  "Message Cluster.gtype" = cluster{"Message": string, "Message Data": variant}
diagram:
  Dequeue Element(queue=$"message queue in", timeout in ms=$"timeout in milliseconds") -> (element=w1, error out=w2, queue out=w3, timed out?=w4)
  $"message queue out" <- w3
  Property Node(instance in=w1) -> ("Message"=w5, "Message Data"=w6)
  $message <- w5
  $"message data" <- w6
  Merge Errors($"error in", w2) -> (error out=w7)
  $"error out" <- w7
  # This VI pulls messages off the Message Queue. It will dequeue messages regardless of incoming error.
  $"timed out?" <- w4
