vi "globals.gviweb"   [G Web Development Software 22.3.0]
outputs:
  "Globals": "Globals.gtype"
types:
  "Globals.gtype" = cluster{"Simulated Amplifier Factor": f64, "Pass Tolerance (%)": f64, "Hardware Initialize Duration (s)": u32, "Hardware Finalize Duration (s)": u32, "Simulated Amplifier Noise Amplitude (%)": f64, "IO Loop Period (ms)": u32, "UI Polling Period (ms)": u32}
diagram:
  Subtract(x=10, y=1) -> w1
  Property Node(instance in="Globals.gtype" {all zero or empty}, "Simulated Amplifier Factor"=5, "Pass Tolerance (%)"=10, "Simulated Amplifier Noise Amplitude (%)"=w1, "Hardware Initialize Duration (s)"=2, "Hardware Finalize Duration (s)"=2, "IO Loop Period (ms)"=50, "UI Polling Period (ms)"=100) -> (instance out=w2)
  $Globals <- w2
